# Grasshopper definition test.gh (Grasshopper 1.0.7)
# plug-ins: Theano.Rep

brep = Brep(<brep referenced from the Rhino model>)
brep_2 = Brep(<brep referenced from the Rhino model>)
brep_3 = Brep(<brep referenced from the Rhino model>)
pt = Point([<point referenced from the Rhino model> x3])
file = ReadFile(File="C:\Users\cdrie\AppData\Roaming\boxboxbox\Theano\session.txt", PerLineParse=True)
theano = Theano(Data=file, Columns=brep_3, Plinth=brep_2, Swing=brep, Anchors=pt)
